# Grasshopper definition 01_Kangaroo tensioning.gh (Grasshopper 1.0.7)
# Copyright: Co-de-iT
# plug-ins: MeshEdit Components, Kangaroo2 Components

crv = Curve([<curve referenced from the Rhino model> x7])
# Kangaroo tensioning
# 
# © a3 2018 _ Creative Commons Attribution-NonCommercial-ShareAlike3.0 UnportedLicense.
mesh = Mesh(<mesh referenced from the Rhino model>)

# ---- group: mesh to include fixed points
mesh_2 = Mesh([<mesh referenced from the Rhino model> x2])

# ----
loft = Loft(Curves=crv, Options={Adjust=False, Closed=False, LoftEnds=0, LoftSimp=0, LoftType=3, Rebuild=10, Refit=0.01})
nv = NakedVertices(Mesh=mesh)  # -> ClothedIndex, NakedIndex, ClothedPts, NakedPts
mjoin = MeshJoin(Meshes=mesh_2)
debrep = DeconstructBrep(Brep=loft)  # -> Faces, Edges, Vertices
minc = MeshInclusion(Mesh=mjoin, Point=nv.NakedPts, Strict=False)
dispatch = Dispatch(List=nv.NakedPts, DispatchPattern=minc)  # -> ListA, ListB
mesh_uv = MeshSurface(Surface=debrep.Faces, UCount=Slider(5, range=5..100), VCount=Slider(41, range=10..100), Overhang=True, Equalize=False)
pt = Point(dispatch.ListA)
mjoin_2 = MeshJoin(Meshes=mesh_uv)
edgelengths = EdgeLengths(Mesh=mesh, LengthFactor=Slider(0.128, range=0..1), Strength=1)
anchor = Anchor(Point=pt, Strength=10000)
# pre-processing
show = Show(G=mesh)
weldvertices = MeshWeldVertices(Mesh=mjoin_2, Tolerance=0.01)  # -> RuntimeMessage, Mesh
mesh_3 = Mesh(weldvertices.Mesh)
entwine = Entwine(Branch00=show, Branch01=edgelengths, Branch02=anchor, FlattenInputs=True)
demesh = DeconstructMesh(Mesh=mesh_3)  # -> graft(Vertices), Faces, Colours, Normals
crv_cp = CurveClosestPoint(Point=demesh.Vertices, Curve=crv)  # -> Point, Parameter, Distance
on = BooleanToggle(False)
reset = Button()
nv_2 = NakedVertices(Mesh=mesh_3)  # -> ClothedIndex, NakedIndex, ClothedPts, NakedPts
sort = SortList(Keys=crv_cp.Distance)  # -> Keys, ValuesA
# processing
solver = Solver(GoalObjects=entwine, Reset=reset, Threshold=1e-15, Tolerance=0.01, On=on)  # -> I, V, O
item = ListItem(List=sort.Keys, Index=0, Wrap=True)
smaller = SmallerThan(FirstNumber=item, SecondNumber=Slider(0.072, range=0..1))  # -> SmallerThan, OrEqualTo
bang = ExplodeTree(Data=solver.O)
cull = CullPattern(List=demesh.Vertices, CullPattern=smaller.SmallerThan)  # -> flatten(List)
X = UnitX(Factor="150")
edgelengths_2 = EdgeLengths(Mesh=mesh_3, LengthFactor=Slider(0, range=0..1), Strength=1)
anchor_2 = Anchor(Point=cull, Strength=10000)
show_2 = Show(G=mesh_3)
# post-processing
move = Move(Geometry=bang, Motion=X)  # -> Geometry, Transform
entwine_2 = Entwine(Branch00=show_2, Branch01=edgelengths_2, Branch02=anchor_2, FlattenInputs=True)
on_2 = BooleanToggle(True)
reset_2 = Button()
solver_2 = Solver(GoalObjects=entwine_2, Reset=reset_2, Threshold=1e-15, Tolerance=0.01, On=on_2)  # -> I, V, O
bang_2 = ExplodeTree(Data=solver_2.O)
X_2 = UnitX(Factor="50")
move_2 = Move(Geometry=bang_2, Motion=X_2)  # -> Geometry, Transform
